vi "DCVRATIOGUI_eventcontrol.gvi"   [LabVIEW NXG 5.1.0]
panel controls:
  "VoltageDC_control": bool
  "VoltageAC_control": bool
  "CurrentDC_control": bool
  "CurrentAC_control": bool
  "stop": bool
  "Auto Range_DCV": bool = TRUE
  "Auto Zero_DCV": bool = TRUE
  "Aperture NPLC_DCV": f64 = "10 PLC"(10)
  "Aperture Time_DCV": f64 = 0.1
  "Aperture_DCV": bool = TRUE
  "Manual Range_DCV": f64 = "1 V"(1)
  "Auto Range_DCVR": bool = TRUE
  "Manual Range_DCVR": f64 = "1 V"(1)
  "Aperture_DCVR": bool = TRUE
  "Aperture NPLC_DCVR": f64 = "10 PLC"(10)
panel indicators:
  "VoltageDC_indicator": bool
  "VoltageAC_indicator": bool
  "CurrentDC_indicator": bool
  "CurrentAC_indicator": bool
  "DCV Ratio_toenable": bool
  "Auto Impedance_DCV": bool
  "DIG Option On/Off_DCV": bool
  "String_DCV": string
  "String_DCVR": string
  "DIG Option On/Off_DCVR": bool
  "Aperture Time_DCVR": f64
  "DCV Ratio_todisable": bool
  "Auto Impedance_DCVR": bool
diagram:
  # BUTTONS VISIBILITY
  Property Node(instance in=reference to "VoltageAC_control", "Visible"=TRUE, "Disabled"=FALSE)
  Property Node(instance in=reference to "CurrentDC_control", "Visible"=TRUE, "Disabled"=FALSE)
  Property Node(instance in=reference to "CurrentAC_control", "Visible"=TRUE, "Disabled"=FALSE)
  Property Node(instance in=reference to "VoltageDC_indicator", "Visible"=FALSE)
  # MAIN DEFAULTS
  $stop <- FALSE
  Property Node(instance in=reference to "VoltageDC_control", "Visible"=TRUE, "Disabled"=FALSE)
  $VoltageAC_control <- FALSE
  Property Node(instance in=reference to "VoltageAC_indicator", "Visible"=FALSE)
  Property Node(instance in=reference to "CurrentDC_indicator", "Visible"=FALSE)
  Property Node(instance in=reference to "CurrentAC_indicator", "Visible"=FALSE, "Disabled"=FALSE)
  $VoltageDC_control <- FALSE
  $CurrentDC_control <- FALSE
  $CurrentAC_control <- FALSE
  # TITLES VISIBILITY
  Property Node(instance in=reference to unnamed text, "Visible"=TRUE)
  Property Node(instance in=reference to unnamed text, "Visible"=FALSE)
  Property Node(instance in=reference to unnamed text, "Visible"=FALSE)
  # DCV DEFAULTS
  $"Auto Range_DCV" <- TRUE
  Property Node(instance in=reference to unnamed text, "Visible"=FALSE)
  $"Auto Zero_DCV" <- TRUE
  # DCVRATIO VISIBILITY
  Property Node(instance in=reference to "DIG Option On/Off_DCVR", "Visible"=FALSE)
  # DCV VISIBILITY
  Property Node(instance in=reference to "DIG Option On/Off_DCV", "Visible"=FALSE)
  $"DIG Option On/Off_DCV" <- TRUE
  $Aperture_DCV <- TRUE
  Property Node(instance in=reference to "Auto Impedance_DCVR", "Visible"=FALSE)
  Property Node(instance in=reference to "Auto Impedance_DCV", "Visible"=FALSE)
  $"DCV Ratio_toenable" <- FALSE
  $"Auto Impedance_DCV" <- FALSE
  Property Node(instance in=reference to "Manual Range_DCVR", "Visible"=FALSE)
  Property Node(instance in=reference to "Manual Range_DCV", "Visible"=FALSE)
  Property Node(instance in=reference to "Aperture NPLC_DCVR", "Visible"=FALSE)
  Property Node(instance in=reference to "Aperture NPLC_DCV", "Visible"=FALSE)
  Property Node(instance in=reference to "Aperture_DCVR", "Visible"=FALSE)
  Property Node(instance in=reference to "Aperture_DCV", "Visible"=FALSE)
  Property Node(instance in=reference to "Auto Range_DCVR", "Visible"=FALSE)
  Property Node(instance in=reference to "Auto Range_DCV", "Visible"=FALSE)
  Property Node(instance in=reference to "DCV Ratio_todisable", "Visible"=FALSE)
  Property Node(instance in=reference to "DCV Ratio_toenable", "Visible"=FALSE)
  Property Node(instance in=reference to "Aperture Time_DCVR", "Visible"=FALSE)
  Property Node(instance in=reference to "Aperture Time_DCV", "Visible"=FALSE)
  # DCVRATIO DEFAULTS
  $"Auto Range_DCVR" <- TRUE
  $Aperture_DCVR <- TRUE
  Property Node(instance in=reference to "String_DCVR", "Visible"=FALSE)
  Property Node(instance in=reference to "String_DCV", "Visible"=FALSE)
  $"DIG Option On/Off_DCVR" <- TRUE
  $"DCV Ratio_todisable" <- FALSE
  Property Node(instance in=reference to "Auto Zero_DCV", "Visible"=FALSE)
  $"Auto Impedance_DCVR" <- FALSE
  while {
    $CurrentAC_indicator <- $CurrentAC_control
    event {
      on "VoltageDC_control" Value changed {
        Property Node(instance in=reference to unnamed text, "Visible"=TRUE)
        Event Data() -> ("Old Value"=w2, "New Value"=w3)
        Property Node(instance in=reference to "CurrentDC_control", "Visible"=w3, "Value"=FALSE)
        Property Node(instance in=reference to "VoltageDC_control", "Visible"=w2)
        Property Node(instance in=reference to "CurrentAC_control", "Visible"=w3, "Value"=FALSE)
        Property Node(instance in=reference to "VoltageDC_indicator", "Visible"=w3)
        Property Node(instance in=reference to "CurrentDC_indicator", "Visible"=w2)
        Property Node(instance in=reference to "DIG Option On/Off_DCVR", "Visible"=FALSE)
        Property Node(instance in=reference to "VoltageAC_control", "Visible"=w3, "Value"=FALSE)
        Property Node(instance in=reference to "Auto Impedance_DCVR", "Visible"=FALSE)
        Property Node(instance in=reference to "VoltageAC_indicator", "Visible"=w2)
        Property Node(instance in=reference to "Manual Range_DCVR", "Visible"=FALSE)
        Property Node(instance in=reference to "CurrentAC_indicator", "Visible"=w2)
        Property Node(instance in=reference to "Aperture NPLC_DCVR", "Visible"=FALSE)
        Property Node(instance in=reference to "Manual Range_DCV", "Visible"=TRUE)
        Property Node(instance in=reference to "Aperture_DCVR", "Visible"=FALSE)
        Property Node(instance in=reference to "Aperture NPLC_DCV", "Visible"=TRUE)
        Property Node(instance in=reference to "Auto Range_DCVR", "Visible"=FALSE)
        Property Node(instance in=reference to "Aperture Time_DCV", "Visible"=TRUE)
        Property Node(instance in=reference to "DCV Ratio_todisable", "Visible"=FALSE)
        Property Node(instance in=reference to "Aperture Time_DCVR", "Visible"=FALSE)
        Property Node(instance in=reference to "String_DCV", "Visible"=TRUE)
        Property Node(instance in=reference to "String_DCVR", "Visible"=FALSE)
        Property Node(instance in=reference to "Auto Range_DCV", "Visible"=TRUE)
        Property Node(instance in=reference to "DCV Ratio_toenable", "Visible"=TRUE)
        Property Node(instance in=reference to "Auto Impedance_DCV", "Visible"=TRUE)
        Property Node(instance in=reference to "Auto Zero_DCV", "Visible"=TRUE)
        Property Node(instance in=reference to "DIG Option On/Off_DCV", "Visible"=TRUE)
        Property Node(instance in=reference to unnamed text, "Visible"=FALSE)
        Property Node(instance in=reference to unnamed text, "Visible"=FALSE)
        Property Node(instance in=reference to unnamed text, "Visible"=FALSE)
        Property Node(instance in=reference to "Aperture_DCV", "Visible"=TRUE)
        w1 = default
      }
      on "VoltageAC_control" Value changed {
        Property Node(instance in=reference to "Aperture_DCV", "Visible"=FALSE)
        Event Data() -> ("Old Value"=w4, "New Value"=w5)
        Property Node(instance in=reference to "VoltageDC_control", "Visible"=w5, "Value"=FALSE)
        Property Node(instance in=reference to unnamed text, "Visible"=w5)
        Property Node(instance in=reference to "VoltageAC_control", "Visible"=w4)
        Property Node(instance in=reference to "CurrentAC_control", "Visible"=w5, "Value"=FALSE)
        Property Node(instance in=reference to "CurrentDC_indicator", "Visible"=w4)
        Property Node(instance in=reference to "DIG Option On/Off_DCVR", "Visible"=FALSE)
        Property Node(instance in=reference to "CurrentDC_control", "Visible"=w5, "Value"=FALSE)
        Property Node(instance in=reference to "Auto Impedance_DCVR", "Visible"=FALSE)
        Property Node(instance in=reference to "CurrentAC_indicator", "Visible"=w4)
        Property Node(instance in=reference to "Manual Range_DCVR", "Visible"=FALSE)
        Property Node(instance in=reference to "VoltageDC_indicator", "Visible"=w4)
        Property Node(instance in=reference to "Aperture NPLC_DCVR", "Visible"=FALSE)
        Property Node(instance in=reference to "VoltageAC_indicator", "Visible"=w5)
        Property Node(instance in=reference to "Aperture_DCVR", "Visible"=FALSE)
        Property Node(instance in=reference to "Auto Range_DCVR", "Visible"=FALSE)
        Property Node(instance in=reference to "DCV Ratio_toenable", "Visible"=FALSE)
        Property Node(instance in=reference to "DCV Ratio_todisable", "Visible"=FALSE)
        Property Node(instance in=reference to "Aperture NPLC_DCV", "Visible"=FALSE)
        Property Node(instance in=reference to "Aperture Time_DCVR", "Visible"=FALSE)
        Property Node(instance in=reference to "Aperture Time_DCV", "Visible"=FALSE)
        Property Node(instance in=reference to "String_DCVR", "Visible"=FALSE)
        Property Node(instance in=reference to "String_DCV", "Visible"=FALSE)
        Property Node(instance in=reference to "Auto Range_DCV", "Visible"=FALSE)
        Property Node(instance in=reference to unnamed text, "Visible"=FALSE)
        Property Node(instance in=reference to "Auto Impedance_DCV", "Visible"=FALSE)
        Property Node(instance in=reference to "Auto Zero_DCV", "Visible"=FALSE)
        Property Node(instance in=reference to "DIG Option On/Off_DCV", "Visible"=FALSE)
        Property Node(instance in=reference to unnamed text, "Visible"=FALSE)
        Property Node(instance in=reference to unnamed text, "Visible"=FALSE)
        Property Node(instance in=reference to "Manual Range_DCV", "Visible"=FALSE)
        w1 = default
      }
      on "CurrentDC_control" Value changed {
        Event Data() -> ("Old Value"=w6, "New Value"=w7)
        Property Node(instance in=reference to "VoltageAC_control", "Visible"=w7, "Value"=FALSE)
        Property Node(instance in=reference to "VoltageAC_indicator", "Visible"=w6)
        Property Node(instance in=reference to "VoltageDC_indicator", "Visible"=w6)
        Property Node(instance in=reference to "VoltageDC_control", "Visible"=w7, "Value"=FALSE)
        Property Node(instance in=reference to "CurrentAC_control", "Visible"=w7, "Value"=FALSE)
        Property Node(instance in=reference to "CurrentDC_indicator", "Visible"=w7)
        Property Node(instance in=reference to "CurrentDC_control", "Visible"=w6)
        Property Node(instance in=reference to "CurrentAC_indicator", "Visible"=w6)
        w1 = default
      }
      on "CurrentAC_control" Value changed {
        Event Data() -> ("Old Value"=w8, "New Value"=w9)
        Property Node(instance in=reference to "CurrentDC_indicator", "Visible"=w8)
        Property Node(instance in=reference to "VoltageDC_indicator", "Visible"=w8)
        Property Node(instance in=reference to "VoltageDC_control", "Visible"=w9, "Value"=FALSE)
        Property Node(instance in=reference to "CurrentDC_control", "Visible"=w9, "Value"=FALSE)
        Property Node(instance in=reference to "CurrentAC_indicator", "Visible"=w9)
        Property Node(instance in=reference to "VoltageAC_control", "Visible"=w9, "Value"=FALSE)
        Property Node(instance in=reference to "VoltageAC_indicator", "Visible"=w8)
        Property Node(instance in=reference to "CurrentAC_control", "Visible"=w8)
        w1 = default
      }
      on "Aperture NPLC_DCV" Value changed; "Aperture Time_DCV" Value changed; "Aperture_DCV" Value changed; "Auto Impedance_DCV" Value changed; "Auto Range_DCV" Value changed; "Auto Zero_DCV" Value changed; "DIG Option On/Off_DCV" Value changed; "Manual Range_DCV" Value changed {
        Property Node(instance in=reference to "Aperture_DCV") -> ("Value"=w10)
        Property Node(instance in=reference to "DIG Option On/Off_DCV") -> ("Value"=w11)
        case (w11) {
          frame False, Default {
            w12 = [0, 1, 2]
          }
          frame True {
            w12 = i32[] []
          }
        }
        Not(x=w10) -> w13
        Property Node(instance in=reference to "Aperture NPLC_DCV", "Disabled"=w13, "DisabledIndexes"=w12) -> ("Value"=w14)
        case (w11) {
          frame False, Default {
            w15 = 0.0002
          }
          frame True {
            w15 = 2e-05
          }
        }
        Property Node(instance in=reference to "Aperture Time_DCV", "Disabled"=w10, "Minimum"=w15) -> ("Value"=w16)
        Quotient And Remainder(x=w16, y=2e-06) -> (floor(x/y)=w17, x-y*floor(x/y)=w18)
        Multiply(w18, 1000000) -> w19
        Round To Nearest(number=w19) -> w20
        To Signed 32 Bit Integer(number=w20) -> w21
        case (w21) {
          frame 0, Default {
            Multiply(2e-06, w17) -> w22
          }
          frame 1 {
            Multiply(2e-06, w17) -> w22
          }
          frame 2 {
            Add(1, w17) -> w23
            Multiply(2e-06, w23) -> w22
          }
        }
        case (w10) {
          frame False, Default {
            Format Into String(formatString="%_6ps", initString="Aperture Time: ", w22) -> w24
          }
          frame True {
            Format Into String(formatString="%#gPLC", initString="Aperture NPLC: ", w14) -> w24
          }
        }
        Property Node(instance in=reference to "Auto Range_DCV") -> ("Value"=w25)
        Property Node(instance in=reference to "Manual Range_DCV", "Disabled"=w25) -> ("Value"=w26)
        case (w25) {
          frame False, Default {
            Format Into String(formatString="%.0pV", initString="Range: ", w26) -> w27
          }
          frame True {
            w27 = "Range: Auto"
          }
        }
        Property Node(instance in=reference to "Auto Impedance_DCV") -> ("Value"=w28)
        case (w28) {
          frame False, Default {
            w29 = "Input Z: 10MΩ"
          }
          frame True {
            w29 = "Input Z: Auto"
          }
        }
        Property Node(instance in=reference to "Auto Zero_DCV") -> ("Value"=w30)
        case (w30) {
          frame False, Default {
            w31 = "Auto Zero: Off"
          }
          frame True {
            w31 = "Auto Zero: On"
          }
        }
        Concatenate Strings("Your settings:", "\r\n", w27, "\r\n", w24, "\r\n", w31, "\r\n", w29, "\r\n", "DCV Ratio: Off") -> w32
        $String_DCV <- w32
        Property Node(instance in=reference to "Aperture Time_DCV", "Value"=w22)
        w1 = default
      }
      on "stop" Value changed; "Window" Close {
        w1 = TRUE
      }
      on "DCV Ratio_toenable" Value changed {
        Property Node(instance in=reference to "Auto Range_DCV", "Visible"=FALSE)
        Property Node(instance in=reference to "String_DCV", "Visible"=FALSE)
        Property Node(instance in=reference to "DIG Option On/Off_DCVR", "Visible"=TRUE)
        Property Node(instance in=reference to "Auto Zero_DCV", "Visible"=FALSE)
        Property Node(instance in=reference to "Auto Impedance_DCVR", "Visible"=TRUE)
        Property Node(instance in=reference to "Manual Range_DCVR", "Visible"=TRUE)
        Property Node(instance in=reference to "Aperture NPLC_DCVR", "Visible"=TRUE)
        Property Node(instance in=reference to "Aperture_DCV", "Visible"=FALSE)
        Property Node(instance in=reference to "Aperture_DCVR", "Visible"=TRUE)
        Property Node(instance in=reference to unnamed text, "Visible"=FALSE)
        Property Node(instance in=reference to "Auto Range_DCVR", "Visible"=TRUE)
        Property Node(instance in=reference to "DCV Ratio_toenable", "Visible"=FALSE)
        Property Node(instance in=reference to "DCV Ratio_todisable", "Visible"=TRUE)
        Property Node(instance in=reference to unnamed text, "Visible"=TRUE)
        Property Node(instance in=reference to "Aperture Time_DCVR", "Visible"=TRUE)
        Property Node(instance in=reference to "Manual Range_DCV", "Visible"=FALSE)
        Property Node(instance in=reference to "String_DCVR", "Visible"=TRUE)
        Property Node(instance in=reference to unnamed text, "Visible"=FALSE)
        Event Data() -> ("New Value"=w33)
        Property Node(instance in=reference to "DCV Ratio_todisable", "Visible"=w33, "Value"=w33)
        Property Node(instance in=reference to "Aperture NPLC_DCV", "Visible"=FALSE)
        Property Node(instance in=reference to "VoltageAC_indicator", "Visible"=FALSE)
        Property Node(instance in=reference to "DCV Ratio_toenable", "Visible"=FALSE)
        Property Node(instance in=reference to unnamed text, "Visible"=FALSE)
        Property Node(instance in=reference to "DIG Option On/Off_DCV", "Visible"=FALSE)
        Property Node(instance in=reference to "Aperture Time_DCV", "Visible"=FALSE)
        Property Node(instance in=reference to "Auto Impedance_DCV", "Visible"=FALSE)
        w1 = default
      }
      on "DCV Ratio_todisable" Value changed {
        Property Node(instance in=reference to "Auto Range_DCV", "Visible"=TRUE)
        Property Node(instance in=reference to "String_DCV", "Visible"=TRUE)
        Property Node(instance in=reference to "DIG Option On/Off_DCVR", "Visible"=FALSE)
        Property Node(instance in=reference to "DIG Option On/Off_DCV", "Visible"=TRUE)
        Property Node(instance in=reference to "Auto Zero_DCV", "Visible"=TRUE)
        Property Node(instance in=reference to "Auto Impedance_DCVR", "Visible"=FALSE)
        Property Node(instance in=reference to "Aperture Time_DCV", "Visible"=TRUE)
        Property Node(instance in=reference to "Manual Range_DCVR", "Visible"=FALSE)
        Property Node(instance in=reference to "Aperture NPLC_DCVR", "Visible"=FALSE)
        Property Node(instance in=reference to "Aperture_DCV", "Visible"=TRUE)
        Property Node(instance in=reference to "Aperture_DCVR", "Visible"=FALSE)
        Property Node(instance in=reference to unnamed text, "Visible"=FALSE)
        Property Node(instance in=reference to "Auto Range_DCVR", "Visible"=FALSE)
        Property Node(instance in=reference to "DCV Ratio_todisable", "Visible"=FALSE)
        Property Node(instance in=reference to unnamed text, "Visible"=FALSE)
        Property Node(instance in=reference to "Aperture Time_DCVR", "Visible"=FALSE)
        Property Node(instance in=reference to "Manual Range_DCV", "Visible"=TRUE)
        Property Node(instance in=reference to "String_DCVR", "Visible"=FALSE)
        Property Node(instance in=reference to unnamed text, "Visible"=TRUE)
        Property Node(instance in=reference to "Aperture NPLC_DCV", "Visible"=TRUE)
        Event Data() -> ("New Value"=w34)
        Property Node(instance in=reference to "DCV Ratio_toenable", "Visible"=TRUE, "Value"=w34)
        Property Node(instance in=reference to "Auto Impedance_DCV", "Visible"=TRUE)
        w1 = default
      }
      on "Aperture NPLC_DCVR" Value changed; "Aperture Time_DCVR" Value changed; "Aperture_DCVR" Value changed; "Auto Impedance_DCVR" Value changed; "Auto Range_DCVR" Value changed; "DIG Option On/Off_DCVR" Value changed; "Manual Range_DCVR" Value changed {
        Property Node(instance in=reference to "Aperture_DCVR") -> ("Value"=w35)
        Property Node(instance in=reference to "DIG Option On/Off_DCVR") -> ("Value"=w36)
        case (w36) {
          frame False, Default {
            w37 = [0, 1, 2]
          }
          frame True {
            w37 = i32[] []
          }
        }
        Not(x=w35) -> w38
        Property Node(instance in=reference to "Aperture NPLC_DCVR", "Disabled"=w38, "DisabledIndexes"=w37) -> ("Value"=w39)
        case (w36) {
          frame False, Default {
            w40 = 0.0002
          }
          frame True {
            w40 = 2e-05
          }
        }
        Property Node(instance in=reference to "Aperture Time_DCVR", "Disabled"=w35, "Minimum"=w40) -> ("Value"=w41)
        Quotient And Remainder(x=w41, y=2e-06) -> (floor(x/y)=w42, x-y*floor(x/y)=w43)
        Multiply(w43, 1000000) -> w44
        Round To Nearest(number=w44) -> w45
        To Signed 32 Bit Integer(number=w45) -> w46
        case (w46) {
          frame 0, Default {
            Multiply(2e-06, w42) -> w47
          }
          frame 1 {
            Multiply(2e-06, w42) -> w47
          }
          frame 2 {
            Add(1, w42) -> w48
            Multiply(2e-06, w48) -> w47
          }
        }
        case (w35) {
          frame False, Default {
            Format Into String(formatString="%_6ps", initString="Aperture Time: ", w47) -> w49
          }
          frame True {
            Format Into String(formatString="%#gPLC", initString="Aperture NPLC: ", w39) -> w49
          }
        }
        Property Node(instance in=reference to "Auto Range_DCVR") -> ("Value"=w50)
        Property Node(instance in=reference to "Manual Range_DCVR", "Disabled"=w50) -> ("Value"=w51)
        case (w50) {
          frame False, Default {
            Format Into String(formatString="%.0pV", initString="Range: ", w51) -> w52
          }
          frame True {
            w52 = "Range: Auto"
          }
        }
        Property Node(instance in=reference to "Auto Impedance_DCVR") -> ("Value"=w53)
        case (w53) {
          frame False, Default {
            w54 = "Input Z: 10MΩ"
          }
          frame True {
            w54 = "Input Z: Auto"
          }
        }
        Concatenate Strings("Your settings:", "\r\n", w52, "\r\n", w49, "\r\n", "Auto Zero cannot be disabled during DCV Ratio", "\r\n", w54, "\r\n", "DCV Ratio: On") -> w55
        $String_DCVR <- w55
        Property Node(instance in=reference to "Aperture Time_DCVR", "Value"=w47)
        w1 = default
      }
    }
    $VoltageAC_indicator <- $VoltageAC_control
    $VoltageDC_indicator <- $VoltageDC_control
    $CurrentDC_indicator <- $CurrentDC_control
    stop if w1
  }
